# Grasshopper definition 2023_DigitalesEntwerfen_Tutorials_Arrays.gh (Grasshopper 1.0.8)
# plug-ins: Bifocals

panel = Panel("arrays")
circle = Circle(Plane=PlaneXY(0, 0, 0), Radius=Slider(22, range=0..100))
unit_x = UnitX(Factor=Slider(55, range=0..100))
linear_array = LinearArray(Geometry=circle, Direction=unit_x, Count=10)  # -> Geometry, Transform
unit_x_2 = UnitX(Factor=Slider(125, range=0..150))
circle_2 = Circle(Plane=PlaneXY(0, 0, 0), Radius=Slider(15, range=0..100))
move = Move(Geometry=circle_2, Motion=unit_x_2)  # -> Geometry, Transform
polar_array = PolarArray(Geometry=move.Geometry, Plane=PlaneXY(0, 0, 0), Count=10, Angle=degrees(Slider(180, range=0..360)))  # -> Geometry, Transform
circle_3 = Circle(Plane=PlaneXY(0, 0, 0), Radius=Slider(22, range=0..100))
rectangle = Rectangle(Plane=PlaneXY(0, 0, 0), XSize=Slider(55, range=0..100), YSize=Slider(51, range=0..100), Radius=0)  # -> Rectangle, Length
rectangular_array = RectangularArray(Geometry=circle_3, Cell=rectangle.Rectangle, XCount=Slider(5, range=0..10), YCount=Slider(5, range=0..10))  # -> Geometry, Transform
number_slider = Slider(28, range=0..100)
circle_4 = Circle(Plane=PlaneXY(0, 0, 0), Radius=Slider(23, range=0..100))
center_box = CenterBox(Base=PlaneXY(0, 0, 0), X=number_slider, Y=number_slider, Z=number_slider)
box_array = BoxArray(
    Geometry=circle_4,
    Cell=center_box,
    XCount=Slider(3, range=0..10),
    YCount=Slider(3, range=0..10),
    ZCount=Slider(3, range=0..10))  # -> Geometry, Transform
number_slider_2 = Slider(26, range=0..100)
circle_5 = Circle(Plane=PlaneXY(0, 0, 0), Radius=Slider(7, range=0..100))
X = UnitX(Factor=number_slider_2)
circle_6 = Circle(Plane=PlaneXY(0, 0, 0), Radius=number_slider_2)
move_2 = Move(Geometry=circle_5, Motion=X)  # -> Geometry, Transform
curve_array = CurveArray(Geometry=move_2.Geometry, Curve=circle_6, Count=10)  # -> Geometry, Transform
