# Grasshopper definition 2023_DigitalesEntwerfen_Tutorials_Trees.gh (Grasshopper 1.0.8)
# plug-ins: Bifocals

panel = Panel("""1
2
3
4
5
6""")
number_slider = Slider(2, range=0..10)
panel_2 = Panel("""1
2
3
4
5
6""")
partition_list = PartitionList(List=panel_2, Size=Slider(2, range=0..10))
partition_list_2 = PartitionList(List=panel, Size=number_slider)  # -> graft(Chunks)
partition_list_3 = PartitionList(List=panel, Size=number_slider)  # -> simplify(graft(Chunks))
partition_list_4 = PartitionList(List=panel, Size=number_slider)  # -> reverse(Chunks)
partition_list_5 = PartitionList(List=panel, Size=number_slider)  # -> flatten(Chunks)
partition_list_6 = PartitionList(List=panel, Size=number_slider)  # -> simplify(Chunks)
partition_list_7 = PartitionList(List=panel, Size=number_slider)
panel_3 = Panel(partition_list)
panel_4 = Panel(partition_list_5)
panel_5 = Panel(partition_list_6)
panel_6 = Panel(partition_list_2)
panel_7 = Panel(partition_list_3)
panel_8 = Panel(partition_list_4)
param_viewer = ParamViewer(panel_3)
panel_9 = Panel(partition_list_7)
param_viewer_2 = ParamViewer(panel_4)
param_viewer_3 = ParamViewer(panel_5)
param_viewer_4 = ParamViewer(panel_6)
param_viewer_5 = ParamViewer(panel_7)
param_viewer_6 = ParamViewer(panel_8)
panel_10 = Panel(panel_9)
simplify_tree = SimplifyTree(Tree=panel_10, Front=False)
reverse_list = ReverseList(List=panel_10)
graft_tree = GraftTree(Tree=simplify_tree, IncludeEmptyLists=True, IncludeNullItems=True)
simplify_tree_2 = SimplifyTree(Tree=panel_10, Front=False)
graft_tree_2 = GraftTree(Tree=panel_10, IncludeEmptyLists=True, IncludeNullItems=True)
flatten_tree = FlattenTree(Tree=panel_10, Path="{0}")
panel_11 = Panel(flatten_tree)
panel_12 = Panel(simplify_tree_2)
panel_13 = Panel(graft_tree_2)
panel_14 = Panel(graft_tree)
panel_15 = Panel(reverse_list)
panel_16 = Panel("""1
2
3
4
5
6""")
partition_list_8 = PartitionList(List=panel_16, Size=Slider(2, range=0..10))
panel_17 = Panel(partition_list_8)
panel_18 = Panel("""0;1
0;2""")
data_path = DataPath(panel_18)
list_item = ListItem(List=panel_17, Index=0, Wrap=True)
tree_branch = TreeBranch(Tree=panel_17, Path="0;1", MaintainPaths=True)
explode_tree = ExplodeTree(Data=panel_17)  # -> Branch0, Branch1, Branch2
split_tree = SplitTree(Data=panel_17, Masks=flatten(data_path))  # -> Positive, Negative
panel_19 = Panel(list_item)
panel_20 = Panel(tree_branch)
panel_21 = Panel(explode_tree.Branch0)
panel_22 = Panel(split_tree.Positive)
