# Grasshopper definition Basics_Example_GHX_ListActions.gh (Grasshopper 1.0.8)

# ----
# Example 6  - Sorting Lists
# Example 6 - Sorting Lists
# 
# the sort list component can be a very powerful one. Its default functionality is to sort the list (K). Aside from that input there is the possibility to attach more lists (A,B enz.) These lists will be sorted in the same order as the first list. The contents of the secondary lists don't need to be sortable as the first list (K) should be. The second list can be geometry, text etc.
list = Panel("""1
5
2
7
8
4
3
6
9
10""")
list_2 = Panel("""1
5
2
7
8
4
3
6
9
10""")
list_3 = Panel("""1
5
2
7
8
4
3
6
9
10""")
new_value = Panel("99")
items_to_replace = Panel("""1
5
8""")
_2nd_list = Panel("""hi
secondary list
this is
sorted using
the first
of a
an example
that gets
lists order
as guide """)
sort = SortList(Keys=list_2)  # -> Keys, ValuesA
sort_2 = SortList(Keys=list, ValuesA=_2nd_list)  # -> Keys, ValuesA
replace = ListReplace(List=list_3, Item=new_value, Indices=items_to_replace, Wrap=False)
result = Panel(sort.Keys)
result_2 = Panel(sort_2.Keys)
result_3 = Panel(replace)
result_4 = Panel(sort_2.ValuesA)

# ----
# Example 1 - Item from list
# Example 1 - Item from list
# 
# The List item selects an item from the list. Take note of the indices in the input list (numbers in front of the value). The indices start at 0.
list_4 = Panel("""1
5
2
7
8
4
3
6
9
10""")
item = Slider(5, range=0..9)
item_2 = ListItem(List=list_4, Index=item, Wrap=Toggle(True))
result_5 = Panel(item_2)

# ----
# Example 7 - Split List
# Split list splits a list into two seperate list. The second list starts with the index (i)
slider = Slider(4, range=0..9)
list_5 = Panel("""1
5
2
7
8
4
3
6
9
10""")
split = SplitList(List=list_5, Index=slider)  # -> ListA, ListB
resulta = Panel(split.ListA)
resultb = Panel(split.ListB)

# ----
# Example 2 - Item from list
# Example 2 - Item from list
# 
# The List item selects an item from the list. Take note of the indices in the input list (numbers in front of the value). The indices start at 0.
items = Panel("""2
4
6
1""")
list_6 = Panel("""1
5
2
7
8
4
3
6
9
10""")
item_3 = ListItem(List=list_6, Index=items, Wrap=True)
result_6 = Panel(item_3)

# ----
# Example 3 - Number of items in a list
# The list Length component return the number of items in a list.
# In the second example the length of the list is measured to get the length of the list regardless of the number of values. Note that you will need to subtract 1 from the list length since the indices start at 0!
list_7 = Panel("""1
5
2
7
8
4
3
6
10
9""")
list_8 = Panel("""1
5
2
7
8
4
3
6
9
10""")
lng = ListLength(List=list_7)
lng_2 = ListLength(List=list_8)
addition = Addition(A=lng, B="1")
result_7 = Panel(lng_2)
item_4 = ListItem(List=list_7, Index=addition, Wrap=True)
result_8 = Panel(item_4)

# ----
# Example 8 - Sub List
# With sub list you can select a part of a list using a domain. Elements outside the specified domain will be eliminited from the output.
list_9 = Panel("""1
5
2
7
8
4
3
6
9
10""")
dom = Domain(DomainStart="4", DomainEnd="7")
subset = SubList(List=list_9, Domain=dom, Cycle=False)  # -> List, Index
result_9 = Panel(subset.List)

# ----
# Example 9 - Partition List
# Partition list works as a combination of the "split list" and the "sub list" components. Input (S) sets the split pattern by the amount of items each list should contain. This pattern will be repeated untill all items are placed.
list_10 = Panel("""1
5
2
7
8
4
3
6
9
10""")
panel = Panel("""3
2""")
partition = PartitionList(List=list_10, Size=panel)
result_10 = Panel(partition)

# ----
# Example 4 - Reverse List
# Example 4 - Reverse List
# 
# the purpose of reverse list is quiet obvious. This component could also be used to get the last item of the list by reversing the list and get the 1st item (index 0)
list_11 = Panel("""1
5
2
7
8
4
3
6
9
10""")
rev = ReverseList(List=list_11)
result_11 = Panel(rev)

# ----
# Example 5 - Shift list
# Example 5 - Shift list
# 
# Shift list moves the items in the list by the shift value (S). A positive (S) moves the items up in the list and a negative (S) down. Wrap around (W) prevents items from "falling off" the list by moving them to the other end.
toggle = BooleanToggle(True)
list_12 = Panel("""1
5
2
7
8
4
3
6
9
10""")
shift_by = Slider(1, range=1..10)
shift = ShiftList(List=list_12, Shift=shift_by, Wrap=toggle)
result_12 = Panel(shift)
