# Grasshopper definition Basics_Example_GHX_ListActions_replaceItem.gh (Grasshopper 1.0.8)

panel = Panel("""Floor 0
Floor 1
Floor 2
Floor 3
Floor 4""")
item = Slider(0, range=0..9)
replace = ReplaceItems(List=panel, Item="Ground Floor", Indices=item, Wrap=False)
panel_2 = Panel(replace)
panel_3 = Panel("""1
2
3""")
item_2 = ListItem(List=panel_2, Index=panel_3, Wrap=True)
result = Panel(item_2)
