# Grasshopper definition DigitalesEntwerfen_BasicOperations_BasicGeometry.gh (Grasshopper 1.0.8)
# plug-ins: Bifocals

# basic geometry
number_slider = Slider(27, range=0..100)
xy = XYPlane(Origin=Point(0, 0, 0))
polygon = Polygon(Plane=xy, Radius=number_slider, Segments=Slider(6, range=1..10), FilletRadius=0)  # -> Polygon, Length
crv = Curve(polygon.Polygon)
xy_2 = XYPlane(Origin=Point(0, 0, 0))
circle = Circle(Plane=xy_2, Radius=Slider(22, range=0..100))
crv_2 = Curve(circle)
xy_3 = XYPlane(Origin=Point(0, 0, 0))
rectangle = Rectangle(Plane=xy_3, XSize=Slider(28, range=0..100), YSize=Slider(29, range=0..100), Radius=0)  # -> Rectangle, Length
crv_3 = Curve(rectangle.Rectangle)
xy_4 = XYPlane(Origin=Point(0, 0, 0))
ellipse = Ellipse(Plane=xy_4, Radius1=Slider(22, range=0..100), Radius2=Slider(13, range=0..100))  # -> Ellipse, Focus1, Focus2
crv_4 = Curve(ellipse.Ellipse)
xy_5 = XYPlane(Origin=Point(0, 0, 0))
center_box = CenterBox(Base=xy_5, X=Slider(55, range=0..100), Y=Slider(77, range=0..100), Z=Slider(70, range=0..100))
geo = Geometry(center_box)
xy_6 = XYPlane(Origin=Point(0, 0, 0))
sphere = Sphere(Base=xy_6, Radius=Slider(70, range=0..100))
geo_2 = Geometry(sphere)
rad = Radians(Degrees=Slider(90, range=0..100))
xy_7 = XYPlane(Origin=Point(0, 0, 0))
arc = Arc(Plane=xy_7, Radius=Slider(100, range=0..100), Angle=rad)  # -> Arc, Length
geo_3 = Geometry(arc.Arc)
