# Grasshopper definition DigitalesEntwerfen_BasicOperations_Curves.gh (Grasshopper 1.0.8)
# plug-ins: Bifocals

geo = Geometry([Point(0, 0, 0), Point(150, 100, 0), Point(300, 0, 0)])
intcrv = Interpolate(Vertices=geo, Degree=Slider(1, range=0..10), Periodic=False, KnotStyle=1)  # -> Curve, Length, Domain
intcrv_2 = Interpolate(Vertices=geo, Degree=Slider(2, range=0..10), Periodic=False, KnotStyle=1)  # -> Curve, Length, Domain
intcrv_3 = Interpolate(Vertices=geo, Degree=Slider(3, range=0..10), Periodic=False, KnotStyle=1)  # -> Curve, Length, Domain
pline = PolyLine(Vertices=geo, Closed=False)
nurbs = NurbsCurve(Vertices=geo, Degree=Slider(1, range=1..3), Periodic=False)  # -> Curve, Length, Domain
nurbs_2 = NurbsCurve(Vertices=geo, Degree=Slider(2, range=1..3), Periodic=False)  # -> Curve, Length, Domain
geo_2 = Geometry([Point(0, 0, 0), Point(150, 100, 0), Point(300, 0, 0)])
pt = Point([Point(0, 0, 0), Point(300, 0, 0)])
item = ListItem(List=pt, Index=0, Wrap=True)  # -> Item, Item1
intcrv_4 = Interpolate(Vertices=geo_2, Degree=Slider(1, range=0..10), Periodic=False, KnotStyle=1)  # -> Curve, Length, Domain
dist = Distance(PointA=item.Item, PointB=item.Item1)
addition = Addition(A=dist, B=Slider(27, range=0..50))
Y = UnitY(Factor=1)
fillet = Fillet(Curve=intcrv_4.Curve, Radius=Slider(50, range=0..50))
cat = Catenary(PointA=item.Item, PointB=item.Item1, Length=addition, Gravity=Y)
