# Grasshopper definition DigitalesEntwerfen_BasicOperations_Planes.gh (Grasshopper 1.0.8)
# plug-ins: Bifocals

# planes
xy = XYPlane(Origin=Point(0, 0, 0))
xz = XZPlane(Origin=Point(0, 0, 0))
pt = ConstructPoint(XCoordinate=Slider(0, range=0..50), YCoordinate=Slider(0, range=0..50), ZCoordinate=Slider(0, range=0..50))
construct_point = ConstructPoint(XCoordinate=0, YCoordinate=0, ZCoordinate=0)
vector_xyz = VectorXYZ(XComponent=Slider(0, range=0..100), YComponent=Slider(145, range=0..300), ZComponent=0)  # -> Vector, Length
construct_point_2 = ConstructPoint(XCoordinate=0, YCoordinate=0, ZCoordinate=0)
vector_xyz_2 = VectorXYZ(XComponent=Slider(0, range=0..100), YComponent=Slider(145, range=0..300), ZComponent=0)  # -> Vector, Length
yz = YZPlane(Origin=Point(0, 0, 0))
xy_2 = XYPlane(Origin=pt)
move = Move(Geometry=construct_point, Motion=vector_xyz.Vector)  # -> Geometry, Transform
move_2 = Move(Geometry=construct_point_2, Motion=vector_xyz_2.Vector)  # -> Geometry, Transform
xy_3 = XYPlane(Origin=Point(0, 0, 0))
prot = RotatePlane(Plane=xy_3, Angle=degrees(Slider(45, range=0..100)))
line = Line(StartPoint=construct_point, EndPoint=move.Geometry)
line_2 = Line(StartPoint=construct_point_2, EndPoint=move_2.Geometry)
merge = Merge(Data1=Slider(0, range=0..1), Data2=Slider(0.75, range=0..1), Data3=Slider(1, range=0..1))
panel = Panel("""0
20
32""")
pl_offset = PlaneOffset(BasePlane=PlaneXY(0, 0, 0), Offset=panel)
pframes = PerpFrames(Curve=line_2, Count=Slider(2, range=0..10), Align=True)  # -> Frames, Parameters
hframes = HorizontalFrames(Curve=line_2, Count=Slider(2, range=0..10))  # -> Frames, Parameters
pframe = PerpFrame(Curve=line, Parameter=merge)
hframe = HorizontalFrame(Curve=line, Parameter=merge)
xy_4 = XYPlane(Origin=Point(0, 0, 0))
deplane = DeconstructPlane(Plane=xy_4)  # -> Origin, XAxis, YAxis, ZAxis
line_3 = LineSDL(Start=deplane.Origin, Direction=deplane.YAxis, Length=Slider(58, range=0..300))
