# Grasshopper definition DigitalesEntwerfen_BasicOperations_Surfaces.gh (Grasshopper 1.0.8)
# plug-ins: Bifocals

# surfaces
number_slider = Slider(22, range=0..100)
geo = Geometry(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)
crv = Curve([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])
crv_2 = Curve([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])
arc = Arc(Plane=PlaneXY(0, 0, 0), Radius=Slider(46, range=0..100), Angle=Domain(0, 3.141592654))  # -> Arc, Length
polygon = Polygon(Plane=PlaneXY(0, 0, 0), Radius=number_slider, Segments=Slider(3, range=1..10), FilletRadius=0)  # -> Polygon, Length
polygon_2 = Polygon(Plane=PlaneXY(0, 0, 0), Radius=Slider(22, range=0..100), Segments=Slider(3, range=1..10), FilletRadius=0)  # -> Polygon, Length
polygon_3 = Polygon(Plane=PlaneXY(0, 0, 0), Radius=Slider(22, range=0..100), Segments=Slider(3, range=1..10), FilletRadius=0)  # -> Polygon, Length
unit_z = UnitZ(Factor=Slider(65, range=0..200))
cap = CapHoles(Brep=geo)
netsurf = NetworkSurface(CurvesU=crv, CurvesV=crv_2, Continuity=1)
pframe = PerpFrame(Curve=reparameterize(arc.Arc), Parameter=[0, 1])
merge = Merge(Data1=Slider(0, range=0..90), Data2=Slider(90, range=0..90))
boundary = BoundarySurfaces(Edges=polygon.Polygon)
Z = UnitZ(Factor=Slider(65, range=0..200))
extrude = Extrude(Base=polygon_2.Polygon, Direction=unit_z)
prot = RotatePlane(Plane=pframe, Angle=degrees(merge))
move = Move(Geometry=polygon_3.Polygon, Motion=Z)  # -> Geometry, Transform
polygon_4 = Polygon(Plane=prot, Radius=Slider(22, range=0..100), Segments=Slider(3, range=1..10), FilletRadius=0)  # -> Polygon, Length
rotate = Rotate(Geometry=move.Geometry, Angle=degrees(Slider(45, range=0..100)), Plane=PlaneXY(0, 0, 0))  # -> Geometry, Transform
swp1 = Sweep1(Rail=arc.Arc, Sections=polygon_4.Polygon, Miter=1)
merge_2 = Merge(Data1=polygon_3.Polygon, Data2=rotate.Geometry)
loft = Loft(Curves=merge_2, Options={Adjust=False, Closed=False, LoftEnds=0, LoftSimp=0, LoftType=0, Rebuild=10, Refit=0.01})
