# Grasshopper definition Basics_exportScreenshot.gh (Grasshopper 1.0.7)

captureview = Ladybug_CaptureView(
    fileName="8",
    folder="C:\Users\Nick\Dropbox\Images\Day01_FormFinding",
    viewNames="1",
    imageWidth="1920",
    imageHeight="1080",
    displayMode="Shaded",
    capture=Button())  # -> imagePath; plug-in component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
panel = Panel(captureview)
