# Grasshopper definition 01a_parametricTower.gh (Grasshopper 1.0.8)

# ----
# inputs
tower_center_point = Panel("0,0,0")
number_slider = Slider(4, range=4..9)
number_slider_2 = Slider(7.858, range=1..10.001)
tower_height = Slider(100, range=1..100)
pt = Point(tower_center_point)

fillet_radius = Slider(0.47, range=0..1)

# ----
# 1.Base & top
Z = UnitZ(Factor=tower_height)
move = Move(Geometry=pt, Motion=Z)  # -> Geometry, Transform
ln = Line(StartPoint=pt, EndPoint=move.Geometry)
polygon = Polygon(Plane=pt, Radius=number_slider_2, Segments=number_slider, FilletRadius=fillet_radius)  # -> Polygon, Length
polygon_2 = Polygon(Plane=move.Geometry, Radius=number_slider_2, Segments=number_slider, FilletRadius=fillet_radius)  # -> Polygon, Length
