# Grasshopper definition 01b_parametricTower.gh (Grasshopper 1.0.8)

# ----
# inputs
rotation_in_degrees = Slider(42, range=0..90)
tower_center_point = Panel("0,0,0")
number_slider = Slider(4, range=4..9)
number_slider_2 = Slider(7.858, range=1..10.001)
tower_height = Slider(100, range=1..100)
pt = Point(tower_center_point)

number_slider_3 = Slider(0.47, range=0..1)

# ----
# 1.Base & top
Z = UnitZ(Factor=tower_height)
move = Move(Geometry=pt, Motion=Z)  # -> Geometry, Transform
ln = Line(StartPoint=pt, EndPoint=move.Geometry)
polygon = Polygon(Plane=pt, Radius=number_slider_2, Segments=number_slider, FilletRadius=number_slider_3)  # -> Polygon, Length
polygon_2 = Polygon(Plane=move.Geometry, Radius=number_slider_2, Segments=number_slider, FilletRadius=number_slider_3)  # -> Polygon, Length

# ----
# 2. Rotation (top)
rad = Radians(Degrees=rotation_in_degrees)
rotate = Rotate(Geometry=polygon_2.Polygon, Angle=rad, Plane=PlaneXY(0, 0, 0))  # -> Geometry, Transform
