# Grasshopper definition 01c_parametricTower.gh (Grasshopper 1.0.8)

# ----
# inputs
floor_height = Slider(3.5, range=2.8..4.8)
tower_height = Slider(100, range=1..100)
rotation_in_degrees = Slider(42, range=0..90)
number_slider = Slider(4, range=4..9)
number_slider_2 = Slider(7.858, range=1..10.001)
tower_center_point = Panel("0,0,0")
slab_thickness = Slider(0.2, range=0.1..0.6)
pt = Point(tower_center_point)

number_slider_3 = Slider(0.47, range=0..1)

# ----
# 1.Base & top
Z = UnitZ(Factor=tower_height)
move = Move(Geometry=pt, Motion=Z)  # -> Geometry, Transform
ln = Line(StartPoint=pt, EndPoint=move.Geometry)
polygon = Polygon(Plane=pt, Radius=number_slider_2, Segments=number_slider, FilletRadius=number_slider_3)  # -> Polygon, Length
polygon_2 = Polygon(Plane=move.Geometry, Radius=number_slider_2, Segments=number_slider, FilletRadius=number_slider_3)  # -> Polygon, Length

# ----
# 2. Rotation (top)
rad = Radians(Degrees=rotation_in_degrees)
rotate = Rotate(Geometry=polygon_2.Polygon, Angle=rad, Plane=PlaneXY(0, 0, 0))  # -> Geometry, Transform

# ----
# 3. Massing
loft = Loft(
    Curves=[polygon.Polygon, rotate.Geometry],
    Options={Adjust=False, Closed=False, LoftEnds=0, LoftSimp=0, LoftType=0, Rebuild=10, Refit=0.01})
cap = CapHoles(Brep=loft)
