# Grasshopper definition 01d_parametricTower.gh (Grasshopper 1.0.8)

# ----
# inputs
tower_center_point = Panel("0,0,0")
number_slider = Slider(4, range=4..9)
number_slider_2 = Slider(8.006, range=1..30.001)
rotation_in_degrees = Slider(0, range=0..90)
tower_max_height = Slider(50, range=1..100)
pt = Point(tower_center_point)

fillet_radius = Slider(0, range=0..1)

# ----
# 1.Base & top
Z = UnitZ(Factor=tower_max_height)
move = Move(Geometry=pt, Motion=Z)  # -> Geometry, Transform
polygon = Polygon(Plane=pt, Radius=number_slider_2, Segments=number_slider, FilletRadius=fillet_radius)  # -> Polygon, Length
polygon_2 = Polygon(Plane=move.Geometry, Radius=number_slider_2, Segments=number_slider, FilletRadius=fillet_radius)  # -> Polygon, Length
ln = Line(StartPoint=pt, EndPoint=move.Geometry)

# ----
# 2. Rotation (top)
rad = Radians(Degrees=rotation_in_degrees)
rotate = Rotate(Geometry=polygon_2.Polygon, Angle=rad, Plane=PlaneXY(0, 0, 0))  # -> Geometry, Transform

floor_height_m = Slider(3.5, range=0..7)

# ----
# 3. Massing
loft = Loft(
    Curves=[polygon.Polygon, rotate.Geometry],
    Options={Adjust=False, Closed=False, LoftEnds=0, LoftSimp=0, LoftType=0, Rebuild=10, Refit=0.01})
cap = CapHoles(Brep=loft)

# ----
# 4. Create Floors
divdist = DivideDistance(Curve=ln, Distance=floor_height_m)  # -> Points, Tangents, Parameters
xy = XYPlane(Origin=divdist.Points)
brep_plane = BrepPlane(Brep=cap, Plane=xy)  # -> Curves, Points
xy_2 = XYPlane(Origin=Point(0, 0, 0))
offset = OffsetCurve(Curve=brep_plane.Curves, Distance=expr("-x", 1), Plane=xy_2, Corners=1)
boundary = BoundarySurfaces(Edges=offset)  # -> flatten(Surfaces)

xy_plane = XYPlane(Origin=Point(0, 0, 0))

# ----
# add thickness
slab_thickness = Panel("0.2")
Z_2 = UnitZ(Factor=slab_thickness)
extr = Extrude(Base=boundary, Direction=Z_2)
cap_holes = CapHoles(Brep=extr)
