# Grasshopper definition 01f_parametricTower.gh (Grasshopper 1.0.8)

# ----
# inputs
tower_center_point = Panel("0,0,0")
number_slider = Slider(4, range=4..9)
tower_height_m = Slider(50, range=1..100)
slab_thickness_m = Slider(0.2, range=0.1..0.6)
rotation_in_degrees = Slider(14, range=0..90)
corner_fillet_radius = Slider(0, range=0..1)
floor_height_m = Slider(3.5, range=2.8..4.8)
slab_offset = Slider(0.781, range=0..5)
tower_radius = Slider(10, range=3..100)
pt = Point(tower_center_point)

# ----
# 1.Base & top
Z = UnitZ(Factor=tower_height_m)
move = Move(Geometry=pt, Motion=Z)  # -> Geometry, Transform
polygon = Polygon(Plane=pt, Radius=tower_radius, Segments=number_slider, FilletRadius=corner_fillet_radius)  # -> Polygon, Length
ln = Line(StartPoint=pt, EndPoint=move.Geometry)
polygon_2 = Polygon(Plane=move.Geometry, Radius=tower_radius, Segments=number_slider, FilletRadius=corner_fillet_radius)  # -> Polygon, Length

# ----
# 2. Rotation (top)
rad = Radians(Degrees=rotation_in_degrees)
rotate = Rotate(Geometry=polygon_2.Polygon, Angle=rad, Plane=PlaneXY(0, 0, 0))  # -> Geometry, Transform

# ----
# 3. Massing
loft = Loft(
    Curves=[polygon.Polygon, rotate.Geometry],
    Options={Adjust=False, Closed=False, LoftEnds=0, LoftSimp=0, LoftType=0, Rebuild=10, Refit=0.01})
cap = CapHoles(Brep=loft)

# ----
# 4. Create Floors
divdist = DivideDistance(Curve=ln, Distance=floor_height_m)  # -> Points, Tangents, Parameters
xy = XYPlane(Origin=divdist.Points)
brep_plane = BrepPlane(Brep=cap, Plane=xy)  # -> Curves, Points
xy_2 = XYPlane(Origin=Point(0, 0, 0))
offset = OffsetCurve(Curve=brep_plane.Curves, Distance=expr("-x", slab_offset), Plane=xy_2, Corners=1)
boundary = BoundarySurfaces(Edges=brep_plane.Curves)  # -> flatten(Surfaces)
boundary_2 = BoundarySurfaces(Edges=offset)  # -> flatten(Surfaces)

# ----
# 7.Calculate The Gross Floor Area
srf = Surface(boundary_2)
area = Area(Geometry=srf)  # -> Area, Centroid
mass_addition = MassAddition(Input=area.Area)  # -> Result, PartialResults
gross_floor_area = Panel(mass_addition.Result)

srf_2 = Surface(boundary)
Z_2 = UnitZ(Factor=slab_thickness_m)
move_2 = Move(Geometry=srf_2, Motion=Z_2)  # -> Geometry, Transform
list_length = ListLength(List=move_2.Geometry)
subtraction = Subtraction(A=floor_height_m, B=slab_thickness_m)
unit_z = UnitZ(Factor=subtraction)
cull_index = CullIndex(List=move_2.Geometry, Indices=expr("x-1", list_length), Wrap=True)
extrude = Extrude(Base=cull_index, Direction=unit_z)

srf_3 = Surface(boundary_2)
Z_3 = UnitZ(Factor=slab_thickness_m)
extr = Extrude(Base=srf_3, Direction=Z_3)
cap_holes = CapHoles(Brep=extr)

# ----
# 6. Visualize
swatch = ColourSwatch(SwatchColor=RGB(110, 110, 110))
preview = CustomPreview(Geometry=cap_holes, Material=swatch)
preview_2 = CustomPreview(Geometry=extrude, Material=ColourSwatch(SwatchColor=RGBA(156, 199, 219, 128)))
