# Grasshopper definition 01g_parametricTower.gh (Grasshopper 1.0.8)

# ----
# inputs
tower_center_point = Panel("0,0,0")
number_slider = Slider(4, range=4..9)
tower_height_m = Slider(50, range=1..100)
slab_thickness_m = Slider(0.2, range=0.1..0.6)
rotation_in_degrees = Slider(14, range=0..90)
corner_fillet_radius = Slider(0, range=0..1)
floor_height_m = Slider(3.5, range=2.8..4.8)
slab_offset = Slider(0.872, range=0..5)
tower_radius = Slider(10, range=3..100)
pt = Point(tower_center_point)

# ----
# 1.Base & top
Z = UnitZ(Factor=tower_height_m)
move = Move(Geometry=pt, Motion=Z)  # -> Geometry, Transform
polygon = Polygon(Plane=pt, Radius=tower_radius, Segments=number_slider, FilletRadius=corner_fillet_radius)  # -> Polygon, Length
ln = Line(StartPoint=pt, EndPoint=move.Geometry)
polygon_2 = Polygon(Plane=move.Geometry, Radius=tower_radius, Segments=number_slider, FilletRadius=corner_fillet_radius)  # -> Polygon, Length

# ----
# 2. Rotation (top)
rad = Radians(Degrees=rotation_in_degrees)
rotate = Rotate(Geometry=polygon_2.Polygon, Angle=rad, Plane=PlaneXY(0, 0, 0))  # -> Geometry, Transform

# ----
# 3. Massing
loft = Loft(
    Curves=[polygon.Polygon, rotate.Geometry],
    Options={Adjust=False, Closed=False, LoftEnds=0, LoftSimp=0, LoftType=0, Rebuild=10, Refit=0.01})
cap = CapHoles(Brep=loft)

# ----
# 4. Create Floors
divdist = DivideDistance(Curve=ln, Distance=floor_height_m)  # -> Points, Tangents, Parameters
xy = XYPlane(Origin=divdist.Points)
brep_plane = BrepPlane(Brep=cap, Plane=xy)  # -> Curves, Points
xy_2 = XYPlane(Origin=Point(0, 0, 0))
offset = OffsetCurve(Curve=brep_plane.Curves, Distance=expr("-x", slab_offset), Plane=xy_2, Corners=1)
boundary = BoundarySurfaces(Edges=offset)  # -> flatten(Surfaces)

# ----
# 7.Calculate The Gross Floor Area
srf = Surface(boundary)
area = Area(Geometry=srf)  # -> Area, Centroid
mass_addition = MassAddition(Input=area.Area)  # -> Result, PartialResults
panel = Panel(mass_addition.Result)

# ----
# 7a.Visualize geometry that allowed within a MAX GFA
max_allowed_area = Panel("1500")
panel_2 = Panel(mass_addition.PartialResults)
larger_than = LargerThan(FirstNumber=max_allowed_area, SecondNumber=panel_2)  # -> LargerThan, OrEqualTo
cull_pattern = CullPattern(List=boundary, CullPattern=larger_than.OrEqualTo)

floors = Panel(cull_pattern)
srf_2 = Surface(cull_pattern)

# ----
# 6. Visualize
srf_3 = Surface(cull_pattern)
Z_2 = UnitZ(Factor=slab_thickness_m)
list_length = ListLength(List=srf_3)
extr = Extrude(Base=srf_2, Direction=Z_2)
unit_z = UnitZ(Factor=floor_height_m)
cull_index = CullIndex(List=srf_3, Indices=expr("x-1", list_length), Wrap=True)
cap_holes = CapHoles(Brep=extr)
extrude = Extrude(Base=cull_index, Direction=unit_z)
preview = CustomPreview(Geometry=cap_holes, Material=ColourSwatch(SwatchColor=RGB(110, 110, 110)))
preview_2 = CustomPreview(Geometry=extrude, Material=ColourSwatch(SwatchColor=RGBA(156, 199, 219, 128)))
