# Grasshopper definition 251015_DigitalesEntwerfen_GHDrawingExercise.gh (Grasshopper 1.0.8)
# plug-ins: Heteroptera

# ---- group: case 5
number_slider = Slider(78, range=0..100)
cir = Circle(Plane=PlaneXY(0, 0, 0), Radius=Slider(50, range=0..100))
offset = OffsetCurve(Curve=cir, Distance=1, Corners=1)
divide = DivideCurve(Curve=cir, Count=number_slider, Kinks=False)  # -> Points, Tangents, Parameters
divide_2 = DivideCurve(Curve=offset, Count=number_slider, Kinks=False)  # -> Points, Tangents, Parameters
vec2pt = Vector2Pt(PointA=divide.Points, PointB=divide_2.Points, Unitize=False)  # -> Vector, Length
number_slider_2 = Slider(8, range=0..10)
series = Series(Start=Slider(6, range=0..100), Step=Slider(23, range=0..100), Count=expr("x+2", number_slider_2))
partition = PartitionList(List=divide.Points, Size=number_slider_2)  # -> simplify(Chunks)
partition_2 = PartitionList(List=vec2pt.Vector, Size=number_slider_2)  # -> simplify(Chunks)
randomize = RandomizeNumbers(Number=series, Ratio=1)
random = Random(Range=Domain(0, 360), Number=number_slider_2, Seed=Slider(2, range=0..5))
line = LineSDL(Start=simplify(partition), Direction=partition_2, Length=simplify(graft(randomize)))
rotate = Rotate(Geometry=line, Angle=graft(degrees(random)), Plane=PlaneXY(0, 0, 0))  # -> Geometry, Transform

# ---- group: case 4
number_slider_3 = Slider(39, range=0..100)
cir_2 = Circle(Plane=PlaneXY(0, 0, 0), Radius=Slider(50, range=0..100))
offset_2 = OffsetCurve(Curve=cir_2, Distance=1, Corners=1)
divide_3 = DivideCurve(Curve=cir_2, Count=number_slider_3, Kinks=False)  # -> Points, Tangents, Parameters
range = Range(Domain=Domain(0, 1), Steps=number_slider_3)
divide_4 = DivideCurve(Curve=offset_2, Count=number_slider_3, Kinks=False)  # -> Points, Tangents, Parameters
graph = GraphMapper(
    range,
    x0=0,
    x1=1,
    y0=0,
    y1=1,
    container_name="Sine Summation",
    Equation0_px=[0.2, 0.3],
    Equation0_py=[0.2, 0.3],
    Equation1_px=[0.6, 0.9],
    Equation1_py=[0.3, 0.5])
dom = ConstructDomain(DomainStart=Slider(10, range=0..10), DomainEnd=Slider(100, range=0..100))
vec2pt_2 = Vector2Pt(PointA=divide_3.Points, PointB=divide_4.Points, Unitize=False)  # -> Vector, Length
remap = RemapNumbers(Value=graph, Source=Domain(0, 1), Target=dom)  # -> Mapped, Clipped
line_2 = LineSDL(Start=divide_3.Points, Direction=vec2pt_2.Vector, Length=remap.Mapped)

# ---- group: case 2
number_slider_4 = Slider(39, range=0..100)
cir_3 = Circle(Plane=PlaneXY(0, 0, 0), Radius=Slider(50, range=0..100))
offset_3 = OffsetCurve(Curve=cir_3, Distance=1, Corners=1)
divide_5 = DivideCurve(Curve=cir_3, Count=number_slider_4, Kinks=False)  # -> Points, Tangents, Parameters
divide_6 = DivideCurve(Curve=offset_3, Count=number_slider_4, Kinks=False)  # -> Points, Tangents, Parameters
vec2pt_3 = Vector2Pt(PointA=divide_5.Points, PointB=divide_6.Points, Unitize=False)  # -> Vector, Length
line_3 = LineSDL(Start=divide_5.Points, Direction=vec2pt_3.Vector, Length=Slider(116, range=0..1000))

# ---- group: case 3
number_slider_5 = Slider(39, range=0..100)
cir_4 = Circle(Plane=PlaneXY(0, 0, 0), Radius=Slider(50, range=0..100))
offset_4 = OffsetCurve(Curve=cir_4, Distance=1, Corners=1)
divide_7 = DivideCurve(Curve=cir_4, Count=number_slider_5, Kinks=False)  # -> Points, Tangents, Parameters
series_2 = Series(Start=Slider(7, range=0..100), Step=Slider(7, range=0..10), Count=number_slider_5)
divide_8 = DivideCurve(Curve=offset_4, Count=number_slider_5, Kinks=False)  # -> Points, Tangents, Parameters
vec2pt_4 = Vector2Pt(PointA=divide_7.Points, PointB=divide_8.Points, Unitize=False)  # -> Vector, Length
line_4 = LineSDL(Start=divide_7.Points, Direction=vec2pt_4.Vector, Length=series_2)

# ---- group: case 1
# Example 1
number_slider_6 = Slider(50, range=0..100)
cir_5 = Circle(Plane=PlaneXY(0, 0, 0), Radius=number_slider_6)
divide_9 = DivideCurve(Curve=cir_5, Count=Slider(39, range=0..100), Kinks=False)  # -> Points, Tangents, Parameters
line_5 = LineSDL(Start=divide_9.Points, Direction=divide_9.Tangents, Length=Slider(148, range=0..1000))

# ----
dom_2 = ConstructDomain(DomainStart=Slider(15, range=0..100), DomainEnd=Slider(127, range=0..500))

# ---- group: case 4
number_slider_7 = Slider(7, range=0..100)
cir_6 = Circle(Plane=PlaneXY(0, 0, 0), Radius=Slider(48, range=0..100))
divide_10 = DivideCurve(Curve=cir_6, Count=number_slider_7, Kinks=False)  # -> Points, Tangents, Parameters
shatter = Shatter(Curve=cir_6, Parameters=divide_10.Parameters)  # -> reparameterize(Segments)
merge = Merge(Data1=Slider(0.1, range=0..0.1), Data2=Slider(1, range=0..1))
random_2 = Random(Range=Domain(5, 10), Number=number_slider_7, Seed=2)
random_3 = Random(Range=Domain(15, 30), Number=number_slider_7, Seed=2)
shatter_2 = Shatter(Curve=shatter, Parameters=merge)  # -> simplify(Segments)
item = ListItem(List=shatter_2, Index=1, Wrap=True)  # -> flatten(Item)
series_3 = Series(Start=Slider(0, range=0..100), Step=random_2, Count=random_3)  # -> simplify(Series)
offset_5 = OffsetCurve(Curve=graft(item), Distance=simplify(series_3), Corners=1)  # -> simplify(Curve)
random_4 = Random(Range=Domain(15, 360), Number=number_slider_7, Seed=Slider(7, range=0..15))
trim = TrimTree(Tree=offset_5, Depth=1)
rotate_2 = Rotate(Geometry=trim, Angle=graft(degrees(random_4)), Plane=PlaneXY(0, 0, 0))  # -> Geometry, Transform

# ---- group: case 2
cir_7 = Circle(Plane=PlaneXY(0, 0, 0), Radius=Slider(48, range=0..100))
divide_11 = DivideCurve(Curve=cir_7, Count=Slider(7, range=0..100), Kinks=False)  # -> Points, Tangents, Parameters
shatter_3 = Shatter(Curve=cir_7, Parameters=divide_11.Parameters)  # -> reparameterize(Segments)
merge_2 = Merge(Data1=Slider(0.1, range=0..0.1), Data2=Slider(1, range=0..1))
shatter_4 = Shatter(Curve=shatter_3, Parameters=merge_2)  # -> simplify(Segments)
item_2 = ListItem(List=shatter_4, Index=1, Wrap=True)  # -> flatten(Item)
series_4 = Series(Start=Slider(0, range=0..100), Step=Slider(5, range=0..100), Count=Slider(7, range=0..10))
offset_6 = OffsetCurve(Curve=item_2, Distance=simplify(graft(series_4)), Corners=1)  # -> simplify(Curve)
jitter = Jitter(List=series_4, Jitter=1, Seed=2)  # -> Values, Indices
trim_2 = TrimTree(Tree=offset_6, Depth=1)
rotate_3 = Rotate(Geometry=trim_2, Angle=simplify(graft(degrees(series_4))), Plane=PlaneXY(0, 0, 0))  # -> Geometry, Transform

# ---- group: case 3
number_slider_8 = Slider(7, range=0..100)
cir_8 = Circle(Plane=PlaneXY(0, 0, 0), Radius=Slider(48, range=0..100))
divide_12 = DivideCurve(Curve=cir_8, Count=number_slider_8, Kinks=False)  # -> Points, Tangents, Parameters
shatter_5 = Shatter(Curve=cir_8, Parameters=divide_12.Parameters)  # -> reparameterize(Segments)
merge_3 = Merge(Data1=Slider(0.1, range=0..0.1), Data2=Slider(1, range=0..1))
random_5 = Random(Range=Domain(5, 10), Number=number_slider_8, Seed=2)
random_6 = Random(Range=Domain(15, 30), Number=number_slider_8, Seed=2)
shatter_6 = Shatter(Curve=shatter_5, Parameters=merge_3)  # -> simplify(Segments)
item_3 = ListItem(List=shatter_6, Index=1, Wrap=True)  # -> flatten(Item)
series_5 = Series(Start=Slider(0, range=0..100), Step=random_5, Count=random_6)  # -> simplify(Series)
offset_7 = OffsetCurve(Curve=graft(item_3), Distance=simplify(series_5), Corners=1)  # -> simplify(Curve)

# ---- group: case 1
# Example 2
cir_9 = Circle(Plane=PlaneXY(0, 0, 0), Radius=Slider(48, range=0..100))
divide_13 = DivideCurve(Curve=cir_9, Count=Slider(7, range=0..100), Kinks=False)  # -> Points, Tangents, Parameters
shatter_7 = Shatter(Curve=cir_9, Parameters=divide_13.Parameters)  # -> reparameterize(Segments)
merge_4 = Merge(Data1=Slider(0.1, range=0..0.1), Data2=Slider(1, range=0..1))
shatter_8 = Shatter(Curve=shatter_7, Parameters=merge_4)  # -> simplify(Segments)
item_4 = ListItem(List=shatter_8, Index=1, Wrap=True)  # -> flatten(Item)
series_6 = Series(Start=Slider(0, range=0..100), Step=Slider(5, range=0..100), Count=Slider(7, range=0..10))
offset_8 = OffsetCurve(Curve=item_4, Distance=simplify(graft(series_6)), Corners=1)  # -> simplify(Curve)

series_7 = Series(Start=0, Step=Slider(8, range=0..10), Count=Slider(30, range=0..30))
# Example 3
crv = Curve(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)
rotate_4 = Rotate(Geometry=crv, Angle=degrees(series_7), Plane=PlaneXY(0, 0, 0))  # -> Geometry, Transform

# ---- group: case 2
number_slider_9 = Slider(29, range=0..30)
crv_2 = Curve(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)
series_8 = Series(Start=Slider(1, range=0..1), Step=Slider(0.1, range=0..0.1), Count=number_slider_9)
series_9 = Series(Start=0, Step=Slider(8, range=0..10), Count=number_slider_9)
scale = Scale(Geometry=crv_2, Center=Point(0, 0, 0), Factor=series_8)  # -> Geometry, Transform
rotate_5 = Rotate(Geometry=scale.Geometry, Angle=simplify(degrees(series_9)), Plane=PlaneXY(0, 0, 0))  # -> Geometry, Transform

# ---- group: case 3
number_slider_10 = Slider(16, range=0..50)
crv_3 = Curve(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)
crv_4 = Curve(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)
frames = CurveFrames(Curve=reparameterize(crv_4), Count=number_slider_10)  # -> Frames, Parameters
item_5 = ListItem(List=frames.Frames, Index=0, Wrap=True)
dom_3 = ConstructDomain(DomainStart=Slider(1, range=0..1), DomainEnd=Slider(4.1, range=0..10))
orient = Orient(Geometry=crv_3, Source=item_5, Target=frames.Frames)  # -> Geometry, Transform
range_2 = Range(Domain=dom_3, Steps=number_slider_10)
scale_2 = Scale(Geometry=orient.Geometry, Center=frames.Frames, Factor=range_2)  # -> Geometry, Transform

# ---- group: case 4
number_slider_11 = Slider(18, range=0..50)
dom_4 = ConstructDomain(DomainStart=Slider(1, range=0..1), DomainEnd=Slider(4.1, range=0..10))
crv_5 = Curve(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)
crv_6 = Curve(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)
range_3 = Range(Domain=dom_4, Steps=number_slider_11)
frames_2 = CurveFrames(Curve=reparameterize(crv_5), Count=number_slider_11)  # -> Frames, Parameters
scale_3 = Scale(Geometry=crv_6, Center=Point(0, 0, 0), Factor=range_3)  # -> Geometry, Transform
item_6 = ListItem(List=frames_2.Frames, Index=0, Wrap=True)
orient_2 = Orient(Geometry=graft(scale_3.Geometry), Source=item_6, Target=simplify(frames_2.Frames))  # -> simplify(Geometry), Transform

# ---- group: case 5
number_slider_12 = Slider(2, range=0..10)
dom_5 = ConstructDomain(DomainStart=Slider(1, range=0..1), DomainEnd=Slider(4, range=0..10))
crv_7 = Curve(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)
crv_8 = Curve(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)
range_4 = Range(Domain=dom_5, Steps=number_slider_12)
curvepoint = PointOnCurve(crv_8, parameter=0)
scale_4 = Scale(Geometry=crv_8, Center=curvepoint, Factor=range_4)  # -> Geometry, Transform
frames_3 = CurveFrames(Curve=reparameterize(scale_4.Geometry), Count=Slider(33, range=0..50))  # -> Frames, Parameters
item_7 = ListItem(List=flatten(frames_3.Frames), Index=0, Wrap=True)
dom_6 = ConstructDomain(DomainStart=Slider(2.3, range=0..3), DomainEnd=Slider(6.2, range=0..10))
range_5 = Range(Domain=dom_6, Steps=number_slider_12)
scale_5 = Scale(Geometry=crv_7, Center=item_7, Factor=range_5)  # -> Geometry, Transform
orient_3 = Orient(Geometry=graft(scale_5.Geometry), Source=item_7, Target=simplify(frames_3.Frames))  # -> simplify(Geometry), Transform

# ---- group: case 6
number_slider_13 = Slider(78, range=0..100)
cir_10 = Circle(Plane=PlaneXY(0, 0, 0), Radius=Slider(50, range=0..100))
offset_9 = OffsetCurve(Curve=cir_10, Distance=1, Corners=1)
divide_14 = DivideCurve(Curve=cir_10, Count=number_slider_13, Kinks=False)  # -> Points, Tangents, Parameters
divide_15 = DivideCurve(Curve=offset_9, Count=number_slider_13, Kinks=False)  # -> Points, Tangents, Parameters
vec2pt_5 = Vector2Pt(PointA=divide_14.Points, PointB=divide_15.Points, Unitize=False)  # -> Vector, Length
number_slider_14 = Slider(8, range=0..10)
series_10 = Series(Start=Slider(17, range=0..100), Step=Slider(23, range=0..100), Count=expr("x+2", number_slider_14))
partition_3 = PartitionList(List=divide_14.Points, Size=number_slider_14)  # -> simplify(Chunks)
partition_4 = PartitionList(List=vec2pt_5.Vector, Size=number_slider_14)  # -> simplify(Chunks)
random_7 = Random(Range=Domain(0, 360), Number=expr("x+2", number_slider_14), Seed=Slider(3, range=0..5))

# ----
range_6 = Range(Domain=dom_2, Steps=expr("x+1", number_slider_14))
jitter_2 = Jitter(List=range_6, Jitter=1, Seed=2)  # -> Values, Indices

# ---- group: case 6 (continued)
line_6 = LineSDL(Start=simplify(partition_3), Direction=partition_4, Length=simplify(graft(jitter_2.Values)))
rotate_6 = Rotate(Geometry=line_6, Angle=graft(degrees(random_7)), Plane=PlaneXY(0, 0, 0))  # -> Geometry, Transform
