# Grasshopper definition DigitalesEntwerfen_BasicOperations_BasicGeometry.gh (Grasshopper 1.0.8)
# plug-ins: Bifocals

# basic geometry:
# curve based
number_slider = Slider(75, range=0..100)
rad = Radians(Degrees=Slider(90, range=0..100))
xy = XYPlane(Origin=Point(0, 0, 0))
xy_2 = XYPlane(Origin=Point(0, 0, 0))
xy_3 = XYPlane(Origin=Point(0, 0, 0))
xy_4 = XYPlane(Origin=Point(0, 0, 0))
xy_5 = XYPlane(Origin=Point(0, 0, 0))
circle = Circle(Plane=xy_3, Radius=Slider(22, range=0..100))
rectangle = Rectangle(Plane=xy_4, XSize=Slider(28, range=0..100), YSize=Slider(29, range=0..100), Radius=0)  # -> Rectangle, Length
ellipse = Ellipse(Plane=xy_5, Radius1=Slider(22, range=0..100), Radius2=Slider(13, range=0..100))  # -> Ellipse, Focus1, Focus2
polygon = Polygon(Plane=xy_2, Radius=number_slider, Segments=Slider(6, range=1..10), FilletRadius=0)  # -> Polygon, Length
arc = Arc(Plane=xy, Radius=Slider(100, range=0..100), Angle=rad)  # -> Arc, Length
crv = Curve(circle)
geo = Geometry(arc.Arc)
crv_2 = Curve(rectangle.Rectangle)
crv_3 = Curve(ellipse.Ellipse)
crv_4 = Curve(polygon.Polygon)
# basic geometry:
# solid
number_slider_2 = Slider(55, range=0..100)
xy_6 = XYPlane(Origin=Point(0, 0, 0))
xy_7 = XYPlane(Origin=Point(0, 0, 0))
center_box = CenterBox(Base=xy_6, X=number_slider_2, Y=Slider(77, range=0..100), Z=Slider(70, range=0..100))
sphere = Sphere(Base=xy_7, Radius=Slider(70, range=0..100))
geo_2 = Geometry(center_box)
geo_3 = Geometry(sphere)
