# Grasshopper definition DigitalesEntwerfen_BasicOperations_Curves.gh (Grasshopper 1.0.8)
# plug-ins: Bifocals

# curve types
geo = Geometry([Point(0, 0, 0), Point(150, 100, 0), Point(300, 0, 0)])
pt = Point([Point(0, 0, 0), Point(300, 0, 0)])
item = ListItem(List=pt, Index=0, Wrap=True)  # -> Item, Item1
dist = Distance(PointA=item.Item, PointB=item.Item1)
addition = Addition(A=dist, B=Slider(27, range=0..50))
Y = UnitY(Factor=1)
intcrv = Interpolate(Vertices=geo, Degree=Slider(1, range=0..10), Periodic=False, KnotStyle=1)  # -> Curve, Length, Domain
intcrv_2 = Interpolate(Vertices=geo, Degree=Slider(2, range=0..10), Periodic=False, KnotStyle=1)  # -> Curve, Length, Domain
intcrv_3 = Interpolate(Vertices=geo, Degree=Slider(3, range=0..10), Periodic=False, KnotStyle=1)  # -> Curve, Length, Domain
pline = PolyLine(Vertices=geo, Closed=False)
nurbs = NurbsCurve(Vertices=geo, Degree=Slider(1, range=1..3), Periodic=False)  # -> Curve, Length, Domain
nurbs_2 = NurbsCurve(Vertices=geo, Degree=Slider(2, range=1..3), Periodic=False)  # -> Curve, Length, Domain
cat = Catenary(PointA=item.Item, PointB=item.Item1, Length=addition, Gravity=Y)
# fillet
geo_2 = Geometry([Point(0, 0, 0), Point(150, 100, 0), Point(300, 0, 0)])
geo_3 = Geometry([Point(0, 0, 0), Point(150, 100, 0), Point(300, 0, 0)])
geo_4 = Geometry([Point(0, 0, 0), Point(150, 100, 0), Point(300, 0, 0)])
intcrv_4 = Interpolate(Vertices=geo_2, Degree=Slider(1, range=0..10), Periodic=False, KnotStyle=1)  # -> Curve, Length, Domain
intcrv_5 = Interpolate(Vertices=geo_3, Degree=Slider(1, range=0..10), Periodic=False, KnotStyle=1)  # -> Curve, Length, Domain
intcrv_6 = Interpolate(Vertices=geo_4, Degree=Slider(1, range=0..10), Periodic=False, KnotStyle=1)  # -> Curve, Length, Domain
offset = OffsetCurve(Curve=intcrv_5.Curve, Distance=Slider(20, range=0..20), Corners=1)
reb = RebuildCurve(Curve=intcrv_6.Curve, Degree=Slider(2, range=1..3), Count=Slider(4, range=1..10), Tangents=False)
fillet = Fillet(Curve=intcrv_4.Curve, Radius=Slider(50, range=0..50))
# divide
number_slider = Slider(5, range=0..10)
geo_5 = Geometry(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)
divide = DivideCurve(Curve=geo_5, Count=number_slider, Kinks=False)  # -> Points, Tangents, Parameters
divdist = DivideDistance(Curve=geo_5, Distance=Slider(5, range=0..10))  # -> Points, Tangents, Parameters
