# Grasshopper definition DigitalesEntwerfen_BasicOperations_DataInput.gh (Grasshopper 1.0.8)
# plug-ins: Bifocals

panel = Panel(Button())
panel_2 = Panel(Toggle(False))

digit_scroller = DigitScroller(Scroller_Digits=12, Scroller_Prefix="Panel", Scroller_Radix=9, Scroller_Value=-2.25)
knob = ControlKnob(Decimals=2, Limit=True, Maximum=10, Minimum=0, Range=1, Value=0.32)
md_slider = MDSlider(SliderMode=0, slider_value=Point(0.5, 0.5, 0.5), x_domain=Domain(0, 1), y_domain=Domain(0, 1), z_domain=Domain(0, 1))
panel_3 = Panel(Slider(0.25, range=0..1))
panel_4 = Panel(knob)
panel_5 = Panel(md_slider)
panel_6 = Panel(digit_scroller)

list = ValueList({"One": 1, "Two": 2, "Three": 2² - 1, "Four": Sqrt(16)}, selected="One")
list_2 = ValueList({"One": 1, "Two": 2, "Three": 2² - 1, "Four": Sqrt(16)}, selected="One")
list_3 = ValueList({"One": 1, "Two": 2, "Three": 2² - 1, "Four": Sqrt(16)}, selected="One")
panel_7 = Panel(list_3)
panel_8 = Panel(list)
panel_9 = Panel(list_2)

colour = ColourPicker(PickedColour=RGB(171, 0, 0))
panel_10 = Panel(ColourSwatch(SwatchColor=RGB(194, 17, 17)))
panel_11 = Panel(colour)
