# Grasshopper definition DigitalesEntwerfen_BasicOperations_Surfaces.gh (Grasshopper 1.0.8)
# plug-ins: Bifocals

# surface creation
number_slider = Slider(22, range=0..100)
geo = Geometry(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)
crv = Curve([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])
crv_2 = Curve([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])
arc = Arc(Plane=PlaneXY(0, 0, 0), Radius=Slider(46, range=0..100), Angle=Domain(0, 3.141592654))  # -> Arc, Length
polygon = Polygon(Plane=PlaneXY(0, 0, 0), Radius=number_slider, Segments=Slider(3, range=1..10), FilletRadius=0)  # -> Polygon, Length
polygon_2 = Polygon(Plane=PlaneXY(0, 0, 0), Radius=Slider(22, range=0..100), Segments=Slider(3, range=1..10), FilletRadius=0)  # -> Polygon, Length
polygon_3 = Polygon(Plane=PlaneXY(0, 0, 0), Radius=Slider(22, range=0..100), Segments=Slider(3, range=1..10), FilletRadius=0)  # -> Polygon, Length
unit_z = UnitZ(Factor=Slider(65, range=0..200))
cap = CapHoles(Brep=geo)
netsurf = NetworkSurface(CurvesU=crv, CurvesV=crv_2, Continuity=1)
pframe = PerpFrame(Curve=reparameterize(arc.Arc), Parameter=[0, 1])
merge = Merge(Data1=Slider(0, range=0..90), Data2=Slider(90, range=0..90))
boundary = BoundarySurfaces(Edges=polygon.Polygon)
Z = UnitZ(Factor=Slider(65, range=0..200))
extrude = Extrude(Base=polygon_2.Polygon, Direction=unit_z)
prot = RotatePlane(Plane=pframe, Angle=degrees(merge))
move = Move(Geometry=polygon_3.Polygon, Motion=Z)  # -> Geometry, Transform
polygon_4 = Polygon(Plane=prot, Radius=Slider(22, range=0..100), Segments=Slider(3, range=1..10), FilletRadius=0)  # -> Polygon, Length
rotate = Rotate(Geometry=move.Geometry, Angle=degrees(Slider(45, range=0..100)), Plane=PlaneXY(0, 0, 0))  # -> Geometry, Transform
swp1 = Sweep1(Rail=arc.Arc, Sections=polygon_4.Polygon, Miter=1)
merge_2 = Merge(Data1=polygon_3.Polygon, Data2=rotate.Geometry)
loft = Loft(Curves=merge_2, Options={Adjust=False, Closed=False, LoftEnds=0, LoftSimp=0, LoftType=0, Rebuild=10, Refit=0.01})
# surface evaluation
number_slider_2 = Slider(78, range=0..100)
xz_plane = XZPlane(Origin=Point(0, 0, 0))
xz_plane_2 = XZPlane(Origin=Point(0, 0, 0))
unit_y = UnitY(Factor=Slider(120, range=0..300))
arc_2 = Arc(Plane=xz_plane, Radius=number_slider_2, Angle=Domain(0, 3.141592654))  # -> Arc, Length
unit_y_2 = UnitY(Factor=Slider(120, range=0..300))
arc_3 = Arc(Plane=xz_plane_2, Radius=Slider(78, range=0..100), Angle=Domain(0, 3.141592654))  # -> Arc, Length
md_slider = MDSlider(
    SliderMode=0,
    slider_value=Point(0.3790744688, 0.7469033962, 0.5),
    x_domain=Domain(0, 1),
    y_domain=Domain(0, 1),
    z_domain=Domain(0, 1))
extrude_2 = Extrude(Base=arc_2.Arc, Direction=unit_y)
md_slider_2 = MDSlider(
    SliderMode=0,
    slider_value=Point(0.3790744688, 0.7469033962, 0.5),
    x_domain=Domain(0, 1),
    y_domain=Domain(0, 1),
    z_domain=Domain(0, 1))
extrude_3 = Extrude(Base=arc_3.Arc, Direction=unit_y_2)
evaluate_surface = EvaluateSurface(Surface=reparameterize(extrude_2), Point=md_slider)  # -> Point, Normal, UDirection, VDirection, Frame
iso_curve = IsoCurve(Surface=reparameterize(extrude_3), UVPoint=md_slider_2)  # -> UIsocurve, VIsocurve
line_sdl = LineSDL(Start=evaluate_surface.Point, Direction=evaluate_surface.Normal, Length=Slider(50, range=0..100))
