# Grasshopper definition DigitalesEntwerfen_BasicOperations_Vectors.gh (Grasshopper 1.0.8)
# plug-ins: Bifocals

# vectors
number_slider = Slider(0, range=0..100)
vector_xyz = VectorXYZ(XComponent=Slider(16, range=0..100), YComponent=Slider(42, range=0..100), ZComponent=Slider(0, range=0..100))  # -> Vector, Length
construct_point = ConstructPoint(XCoordinate=number_slider, YCoordinate=Slider(0, range=0..100), ZCoordinate=0)
vdis = VectorDisplay(Anchor=construct_point, Vector=vector_xyz.Vector)
move = Move(Geometry=construct_point, Motion=vector_xyz.Vector)  # -> Geometry, Transform
pt = ConstructPoint(XCoordinate=Slider(0, range=0..100), YCoordinate=Slider(0, range=0..100), ZCoordinate=0)
pt_2 = ConstructPoint(XCoordinate=Slider(0, range=0..100), YCoordinate=Slider(46, range=0..100), ZCoordinate=0)
vec2pt = Vector2Pt(PointA=pt, PointB=pt_2, Unitize=False)  # -> Vector, Length
vdis_2 = VectorDisplay(Anchor=pt, Vector=vec2pt.Vector)
pt_3 = ConstructPoint(XCoordinate=Slider(0, range=0..100), YCoordinate=Slider(0, range=0..100), ZCoordinate=0)
pt_4 = ConstructPoint(XCoordinate=Slider(0, range=0..100), YCoordinate=Slider(46, range=0..100), ZCoordinate=0)
vec2pt_2 = Vector2Pt(PointA=pt_3, PointB=pt_4, Unitize=False)  # -> Vector, Length
amp = Amplitude(Vector=vec2pt_2.Vector, Amplitude=Slider(60, range=0..100))
vdis_3 = VectorDisplay(Anchor=pt_3, Vector=amp)
vector_xyz_2 = VectorXYZ(XComponent=Slider(16, range=0..100), YComponent=Slider(42, range=0..100), ZComponent=Slider(0, range=0..100))  # -> Vector, Length
construct_point_2 = ConstructPoint(XCoordinate=Slider(0, range=0..100), YCoordinate=Slider(0, range=0..100), ZCoordinate=0)
cir = Circle(Plane=PlaneXY(0, 0, 0), Radius=3)
move_2 = Move(Geometry=cir, Motion=vector_xyz_2.Vector)  # -> Geometry, Transform
vdis_4 = VectorDisplay(Anchor=construct_point_2, Vector=vector_xyz_2.Vector)
