# Grasshopper definition DigitalesEntwerfen_DataStructure_Lists.gh (Grasshopper 1.0.8)
# plug-ins: Bifocals

# select items from list
panel = Panel("""1
5
2
7""")
item = Slider(3, range=0..9)
# get length
panel_2 = Panel("""1
5
2
7""")
# modify order
panel_3 = Panel("""1
5
2
7""")
# sort
panel_4 = Panel("""1
3
4
2""")
# split
panel_5 = Panel("""1
2
3
4""")
sort_list = SortList(Keys=panel_4)  # -> Keys, ValuesValuesA
reverse_list = ReverseList(List=panel_3)
list_length = ListLength(List=panel_2)
panel_6 = Panel("""True
False""")
panel_7 = Panel("""1
2
3
4
5
6""")
list_item = ListItem(List=panel, Index=item, Wrap=Toggle(True))
split_list = SplitList(List=panel_5, Index=Slider(2, range=0..10))  # -> ListA, ListB
panel_8 = Panel(reverse_list)
panel_9 = Panel(list_length)
panel_10 = Panel(sort_list.Keys)
dispatch = Dispatch(List=panel_7, DispatchPattern=panel_6)  # -> ListA, ListB
panel_11 = Panel(list_item)
panel_12 = Panel(split_list.ListA)
panel_13 = Panel(split_list.ListB)
shift_by = Slider(1, range=1..10)
panel_14 = Panel("""2
3""")
panel_15 = Panel("""1
5
2
7""")
panel_16 = Panel("""1
5
2
7""")
panel_17 = Panel("""1
2
3""")
panel_18 = Panel("""4
5
6""")
panel_19 = Panel(dispatch.ListA)
panel_20 = Panel(dispatch.ListB)
panel_21 = Panel("""1
3
4
2""")
panel_22 = Panel("""A
B
C
D""")
panel_23 = Panel("""1
2
3
4
5
6""")
list_item_2 = ListItem(List=panel_15, Index=panel_14, Wrap=True)
shift_list = ShiftList(List=panel_16, Shift=shift_by, Wrap=Toggle(True))
merge = Merge(Data1=panel_17, Data2=panel_18)
sort_list_2 = SortList(Keys=panel_21, ValuesValuesA=panel_22)  # -> Keys, ValuesValuesA
partition_list = PartitionList(List=panel_23, Size=Slider(2, range=0..10))
panel_24 = Panel(list_item_2)
panel_25 = Panel("""False
True""")
panel_26 = Panel("""1
2
3""")
panel_27 = Panel(shift_list)
panel_28 = Panel("""4
5
6""")
panel_29 = Panel(merge)
panel_30 = Panel(partition_list)
panel_31 = Panel(sort_list_2.Keys)
panel_32 = Panel(sort_list_2.ValuesValuesA)
weave = Weave(Pattern=panel_25, Stream0=panel_26, Stream1=panel_28, NullGaps=False)
panel_33 = Panel("""1
2
3
4""")
panel_34 = Panel(weave)
panel_35 = Panel("""1
2
3""")
panel_36 = Panel("""4
5
6""")
construct_domain = ConstructDomain(DomainStart=Slider(1, range=0..1), DomainEnd=Slider(3, range=0..10))
panel_37 = Panel("""1
2
3
4
5
6""")
replace_items = ReplaceItems(List=panel_33, Item="A", Indices=Slider(2, range=0..10), Wrap=False)
entwine = Entwine(Branch00=panel_35, Branch01=panel_36, FlattenInputs=True)
sub_list = SubList(List=panel_37, Domain=construct_domain, Wrap=True)  # -> List, Index
panel_38 = Panel(replace_items)
panel_39 = Panel(entwine)
panel_40 = Panel(sub_list.List)
panel_41 = Panel(sub_list.Index)
