# Grasshopper definition 2029_261021_Schindelanordnungen_jend_v1.gh (Grasshopper 1.0.8)

construct_point = ConstructPoint(XCoordinate=0, YCoordinate=0, ZCoordinate=0)
point = Point(<point referenced from the Rhino model>)
xz_plane = XZPlane(Origin=construct_point)
deconstruct_plane = DeconstructPlane(Plane=xz_plane)  # -> Origin, XAxis, YAxis, ZAxis
number_slider = Slider(100, range=0..100)
number_slider_2 = Slider(60, range=0..100)
py_2d_xy_anordnung = Python3Script(
    o_plane=xz_plane,
    x_no=number_slider,
    z_no=Slider(100, range=0..100),
    x_dist=number_slider_2,
    z_dist=Slider(25, range=0..100))  # -> out, temp_geom; inputs o_plane: Plane, x_no: Int32, z_no: Int32, x_dist: Double, z_dist: Double
# ---------- py_2d_xy_anordnung: Python ----------
"""
XZ Anordnung von Schindeln
Constructive Research HS26
Huelle
"""

import Rhino.Geometry as rg

# inputs: ...

# variables
temp_geom = []
o_pt = o_plane.Origin

for i in range(x_no):
    for j in range(z_no):
        temp_x = i * x_dist
        temp_z = j * z_dist
        temp_pt = rg.Point3d(o_pt.X + temp_x, o_pt.Y, o_pt.Z + temp_z)
        temp_geom.append(temp_pt)
# ---------- end py_2d_xy_anordnung ----------
series = Series(Start="0", Step=number_slider_2, Count=number_slider)
geometry = Geometry(py_2d_xy_anordnung.temp_geom)
amplitude = Amplitude(Vector=deconstruct_plane.XAxis, Amplitude=series)
move = Move(Geometry=deconstruct_plane.Origin, Motion=amplitude)  # -> Geometry, Transform
