# Grasshopper definition Basics_Example_GHX_Inputs.gh (Grasshopper 1.0.8)

# ---- group: Numeric
digit_scroller = DigitScroller(Scroller_Digits=12, Scroller_Prefix="Panel", Scroller_Radix=9, Scroller_Value=-2.25)
knob = ControlKnob(Decimals=2, Limit=True, Maximum=10, Minimum=0, Range=1, Value=0.32)
# Numeric Inputs
# 
# For numberic inputs the user can select form a predefined range of numbers (set by right-clicking on the input to edit).
# The most used is the "slider" input. The slider can be set to any range of numbers, with a defined precision and whole, odd or even number
# 
# The knob can be set to allow for multiple rotations and thereby have more precise control over the value although changing from a low to a high value might require a few turns (and vice versa)
slider = Slider(0.25, range=0..1)
# Numeric Inputs
# 
# The MD slider can be used to select a 2D value. Usually used to select a point on a surface using U and V coordinates.
md_slider = MDSlider(SliderMode=0, slider_value=Point(0.5, 0.5, 0.5), x_domain=Domain(0, 1), y_domain=Domain(0, 1), z_domain=Domain(0, 1))
panel = Panel(slider)
panel_2 = Panel(digit_scroller)
panel_3 = Panel(knob)
panel_4 = Panel(md_slider)

# ---- group: General
# List Input
# 
# The list input is the most versatile control. By editting the list you can create a predefined set of setting with each there own result. This is annotated using the "=" sign. ie.
# 
# one = 1 will result in 1 as value when "one" is selected
list = ValueList({"One": 1, "Two": 2, "Three": 2² - 1, "Four": Sqrt(16)}, selected="One")
panel_5 = Panel(list)

# ---- group: Color
# Color Input
# 
# The color inputs allow you to select RGB/HSVA colors. This is especially useful when using the custom preview component to color objects in the rhino viewport.
swatch = ColourSwatch(SwatchColor=RGB(194, 17, 17))
colour = ColourPicker(PickedColour=RGB(0, 0, 0))
panel_6 = Panel(swatch)
panel_7 = Panel(colour)

# ---- group: Boolean
# Boolean Input
# 
# Boolean input return either True or False depending on the state of the input. The "Toggle" can be changed from True to False (and vice versa) by double clicking on the button. This value remains untill you double click again to change it.
# The "Button" only changes the value when you click and hold the button. This can be used to trigger a one time event in your definition ie. to reset your model.
button = Button()
panel_8 = Panel(button)
panel_9 = Panel(Toggle(False))
