# Grasshopper definition move_object.gh (Grasshopper 1.0.8)

geometry = Geometry(<surface referenced from the Rhino model>)
xy_plane = XYPlane(Origin=Point(0, 0, 0))
vector_xyz = VectorXYZ(XComponent=Slider(100, range=0..100), YComponent=Slider(46, range=0..100), ZComponent=Slider(52, range=0..100))  # -> Vector, Length
move = Move(Geometry=geometry, Motion=vector_xyz.Vector)  # -> Geometry, Transform
move_2 = Move(Geometry=xy_plane, Motion=vector_xyz.Vector)  # -> Geometry, Transform
line = Line(StartPoint=xy_plane, EndPoint=move_2.Geometry)
